vi "Get Hostname.gviweb"   [LabVIEW NXG 3.1.0]
inputs:
  "minionID": string
  "configuration in": "Configuration.gtype"
  "error in": error
outputs:
  "Hostname": string
  "configuration out": "Configuration.gtype"
  "error out": error
  "Connection": string
panel indicators:
  "body": string
types:
  "Client Handle.gtype" = u32
  "Configuration.gtype" = cluster{"Server URL": string, "Session": "Client Handle.gtype"}
  T1 = cluster{"id": string, "alias": string, "state": string}
uses:
  NI::HTTP::POST Buffer.gvi
diagram:
  $"configuration out" <- $"configuration in"
  Property Node(instance in=$"configuration in") -> ("Session"=w1, "Server URL"=w2)
  Concatenate Strings(w2, "/nisysmgmt/v1/query-systems") -> w3
  w4 = "\\\"\",\n  \"projection\": \"new(id,alias,connected.data.state)\"\n}"
  Concatenate Strings("{  \n  \"filter\": \"id==\\\"", $minionID, w4) -> w5
  call "POST Buffer.gvi"(client handle=w1, url=w3, buffer=w5, error in=$"error in") -> (body=w6, error out=w7)
  $body <- w6
  Unflatten From JSON(JSON string=w6, default null elements=TRUE, error in (no error)=w7, type and defaults=cluster{"count": i32, "data": T1[]} {all zero or empty}) -> (error out=w8, value=w9)
  Property Node(instance in=w9) -> ("data"=w10)
  Array Index(array=w10) -> (out0[_]=w11)
  Property Node(instance in=w11) -> ("alias"=w12, "state"=w13)
  $Hostname <- w12
  case (w13) {
    frame "DISCONNECTED", Default {
      w14 = "Disconnected"
    }
    frame "CONNECTED_REFRESH_PENDING" {
      w14 = "Connecting"
    }
    frame "CONNECTED" {
      w14 = "Connected"
    }
  }
  $Connection <- w14
  $"error out" <- w8
